# Grasshopper definition pick_place_from_geo_and_json_creation.ghx (Grasshopper 1.0.7)

pt = Point(Point(500, 500, 0))
path = FilePath("C:\Users\a\Desktop\pp_frames.json")
pln = Plane(pt)
series = Series(Start=0, Step=Slider(100, range=0..100), Count=10)
pflip = FlipPlane(Plane=pln, ReverseX=False, ReverseY=False, SwapAxes=True)
X = UnitX(Factor=series)
Y = UnitY(Factor=Slider(100, range=0..100))
move = Move(Geometry=pflip, Motion=X)  # -> Geometry, Transform
python = GhPythonScript()  # -> out, a
# ---------- python: Python ----------
from compas_ghpython.utilities import unload_modules

unload_modules("mmec_fab")
# ---------- end python ----------
move_2 = Move(Geometry=move.Geometry, Motion=Y)  # -> Geometry, Transform
python_2 = GhPythonScript(pick_planes=move.Geometry, place_planes=move_2.Geometry, run=Button())  # -> out, a; inputs pick_planes: list of Plane, place_planes: list of Plane
# ---------- python_2: Python ----------
from mmec_fab import RobotClient

if run:
    with RobotClient() as client:
        client.pre()
    
        for pick, place in zip(pick_planes, place_planes):
            client.pick_place(pick, place)
        
        client.post()
# ---------- end python_2 ----------
python_3 = GhPythonScript(pick_planes=move.Geometry, place_planes=move_2.Geometry, file_path=path, save=Button())  # -> out, a; inputs pick_planes: list of Plane, place_planes: list of Plane, save: Boolean
# ---------- python_3: Python ----------
from compas import json_dump

from mmec_fab import rgplane_to_cgframe

pick_frames = [rgplane_to_cgframe(plane) for plane in pick_planes]
place_frames = [rgplane_to_cgframe(plane) for plane in place_planes]

data = {"pick_frames": pick_frames, "place_frames": place_frames}

if save:
    json_dump(data, file_path)
# ---------- end python_3 ----------
